# Grasshopper definition 1stAssignment-r02-Hops.gh (Grasshopper 1.0.7)
# plug-ins: Hops

panel = Panel("C:\Users\ayman\Desktop\IAAC MACAD - BIMSC24\01 - DATA MGMT\01 - 1st SESSION\REPO\DataMgmt-1st-Assignment\1stAssignment-r02.gh")
hops = Hops(
    _Path=panel,
    FOLDS=Slider(2, range=1..10),
    LENGTH=Slider(45, range=1..100),
    BTMSPREAD=5.52,
    BTMRANDOM=11,
    HIEGHT=30,
    TOPSPREAD=2.87,
    TOPRANDOM=16,
    CacheResultsInMemory=True,
    CacheSolveResults=True,
    RemoteDefinitionLocation="C:\Users\ayman\Desktop\IAAC MACAD - BIMSC24\01 - DATA MGMT\01 - 1st SESSION\REPO\DataMgmt-1st-Assignment\1stAssignment-r02.gh",
    RemoteSolveVersion=(0, 1, 0),
    ShowInput_Enabled=False,
    ShowInput_Path=True,
    SynchronousSolve=True)
