# Grasshopper definition 1stAssignment-r02.gh (Grasshopper 1.0.7)
# Spherical spikey thing

btmspread = GetNumber(Slider(5.52, range=1..10), AtLeast=1, AtMost=1, Maximum=1.797693135e+308, Minimum=-1.797693135e+308, TreeAccess=False)
folds = GetInteger(Slider(3, range=1..10), AtLeast=1, AtMost=1, Maximum=2147483647, Minimum=-2147483648, TreeAccess=False)
length = GetInteger(Slider(32, range=1..100), AtLeast=1, AtMost=1, Maximum=2147483647, Minimum=-2147483648, TreeAccess=False)
topspread = GetNumber(Slider(2.87, range=1..10), AtLeast=1, AtMost=1, Maximum=1.797693135e+308, Minimum=-1.797693135e+308, TreeAccess=False)
negative = Negative(Value=btmspread)
negative_2 = Negative(Value=topspread)
series = Series(Start=0, Step=folds, Count=length)
construct_point = ConstructPoint(XCoordinate=0, YCoordinate=0, ZCoordinate=0)
construct_domain = ConstructDomain(DomainStart=negative, DomainEnd=btmspread)
construct_domain_2 = ConstructDomain(DomainStart=negative_2, DomainEnd=topspread)
hieght = GetInteger(Slider(30, range=10..50), AtLeast=1, AtMost=1, Maximum=2147483647, Minimum=-2147483648, TreeAccess=False)
unit_x = UnitX(Factor=series)
btmrandom = GetInteger(Slider(11, range=1..30), AtLeast=1, AtMost=1, Maximum=2147483647, Minimum=-2147483648, TreeAccess=False)
toprandom = GetInteger(Slider(16, range=1..30), AtLeast=1, AtMost=1, Maximum=2147483647, Minimum=-2147483648, TreeAccess=False)
unit_z = UnitZ(Factor=hieght)
random = Random(Range=construct_domain, Number=length, Seed=btmrandom)
move = Move(Geometry=construct_point, Motion=unit_x)  # -> Geometry, Transform
random_2 = Random(Range=construct_domain_2, Number=length, Seed=toprandom)
move_2 = Move(Geometry=move.Geometry, Motion=unit_z)  # -> Geometry, Transform
unit_y = UnitY(Factor=random)
unit_y_2 = UnitY(Factor=random_2)
move_3 = Move(Geometry=move.Geometry, Motion=unit_y)  # -> Geometry, Transform
move_4 = Move(Geometry=move_2.Geometry, Motion=unit_y_2)  # -> Geometry, Transform
nurbs_curve = NurbsCurve(Vertices=move_3.Geometry, Degree=3, Periodic=False)  # -> Curve, Length, Domain
nurbs_curve_2 = NurbsCurve(Vertices=move_4.Geometry, Degree=3, Periodic=False)  # -> Curve, Length, Domain
loft = Loft(
    Curves=[nurbs_curve.Curve, nurbs_curve_2.Curve],
    Options={Adjust=False, Closed=False, LoftEnds=0, LoftSimp=0, LoftType=0, Rebuild=10, Refit=0.01})
context_bake = ContextBake(Geometry=loft)
