# Grasshopper definition Ayman ElNashar-1stAssignment r01.gh (Grasshopper 1.0.7)
# plug-ins: Anemone
# Spherical spikey thing

xy_plane = XYPlane(Origin=Point(0, 0, 0))
radius = GetInteger(Slider(43, range=0..100), AtLeast=1, AtMost=1, Maximum=2147483647, Minimum=-2147483648, TreeAccess=False)
sides = GetInteger(Slider(6, range=4..12), AtLeast=1, AtMost=1, Maximum=2147483647, Minimum=-2147483648, TreeAccess=False)
polygon = Polygon(Plane=xy_plane, Radius=radius, Segments=sides, FilletRadius=0)  # -> Polygon, Length
levels = GetInteger(Slider(7, range=0..10), AtLeast=1, AtMost=1, Maximum=2147483647, Minimum=-2147483648, TreeAccess=False)
curve = Curve(polygon.Polygon)
fast_loop_start = FastLoopStart(Iterations=levels, Curve=curve)  # -> port, Counter, Data
curve_2 = Curve(fast_loop_start.Data)
explode = Explode(Curve=curve_2, Recursive=True)  # -> Segments, Vertices
point_on_curve = PointOnCurve(explode.Segments, parameter=0.333)
l_height = GetInteger(Slider(4, range=1..10), AtLeast=1, AtMost=1, Maximum=2147483647, Minimum=-2147483648, TreeAccess=False)
unit_z = UnitZ(Factor=l_height)
polyline = PolyLine(Vertices=point_on_curve, Closed=True)
move = Move(Geometry=polyline, Motion=unit_z)  # -> Geometry, Transform
fast_loop_end = FastLoopEnd(port=fast_loop_start.port, Exit=False, Data=move.Geometry, RecordData=True, TimeOutVal=0)  # -> flatten(Data)
loft = Loft(
    Curves=[curve_2, fast_loop_end],
    Options={Adjust=False, Closed=False, LoftEnds=0, LoftSimp=0, LoftType=0, Rebuild=100, Refit=0.01})
context_bake = ContextBake(Geometry=loft)
