# Grasshopper definition ROTATING_TOWER_HOPS.gh (Grasshopper 1.0.7)
# plug-ins: Hops

panel = Panel("C:\Users\ayman\Desktop\IAAC MACAD - BIMSC24\01 - DATA MGMT\01 - 1st SESSION\1st Assignment\Ayman ElNashar-1stAssignment r01.gh")
hops = Hops(
    _Path=panel,
    Levels=Slider(8, range=1..10),
    Radius=Slider(24, range=1..100),
    Sides=Slider(8, range=4..12),
    Height=Slider(4, range=4..12),
    CacheResultsInMemory=True,
    CacheSolveResults=True,
    RemoteDefinitionLocation="C:\Users\ayman\Desktop\IAAC MACAD - BIMSC24\01 - DATA MGMT\01 - 1st SESSION\1st Assignment\Ayman ElNashar-1stAssignment r01.gh",
    RemoteSolveVersion=(0, 1, 0),
    ShowInput_Enabled=False,
    ShowInput_Path=True,
    SynchronousSolve=True)
